# Grasshopper definition Code2132-w3 tut.gh (Grasshopper 1.0.7)
# plug-ins: LunchBox, Kangaroo2 Components, Triceratops, Bifocals

# path to json config file
file_path = FilePath("C:\Uni\2024\Term 2\CODE2132\web-page\web-page\assets\config.json")
read_file = ReadFile(File=file_path, PerLineParse=True)
panel = Panel(read_file)
panel_2 = Panel("""0
-1""")
cull_index = CullIndex(List=panel, Indices=panel_2, Wrap=True)
text_split = TextSplit(Text=cull_index, Separators=":")
panel_3 = Panel(cull_index)
replace_text = ReplaceText(Text=text_split, Find="\"", RecursiveReplace=False)
replace_text_2 = ReplaceText(Text=replace_text, Find=",", RecursiveReplace=False)
replace_text_3 = ReplaceText(Text=replace_text_2, Find=" ", RecursiveReplace=False)  # -> simplify(Result)
panel_4 = Panel(replace_text_3)

# ---- group: height of level
number_slider = Slider(3.5, range=0..10)

# ----
list_item = ListItem(List=panel_4, Index=Slider(1, range=0..1), Wrap=True)  # -> flatten(Item)
curve = Curve(graft([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]))

# ---- group: parameter 1
list_item_2 = ListItem(List=list_item, Index=0, Wrap=True)

# ---- group: parameter 2
list_item_3 = ListItem(List=list_item, Index=Slider(1, range=0..1), Wrap=True)

# ---- group: run analysis toggle
list_item_4 = ListItem(List=list_item, Index=Slider(3, range=0..10), Wrap=True)

# ---- group: paramater 4
list_item_5 = ListItem(List=list_item, Index=Slider(2, range=0..10), Wrap=True)

# ---- group: parameter 3
list_item_6 = ListItem(List=list_item, Index=Slider(4, range=0..10), Wrap=True)

# ----
series = Series(Start=number_slider, Step=number_slider, Count=list_item_2)
boolean = Boolean(list_item_4)
unit_z = UnitZ(Factor=series)
move = Move(Geometry=simplify(curve), Motion=unit_z)  # -> simplify(Geometry), Transform
number_slider_2 = Slider(22, range=0..100)
merge = Merge(Data1=simplify(curve), Data2=move.Geometry)
shift_list = ShiftList(List=merge, Shift="1", Wrap=Toggle(False))
cull_index_2 = CullIndex(List=merge, Indices="-1", Wrap=True)
ruled_surface = RuledSurface(CurveA=graft(cull_index_2), CurveB=graft(shift_list))  # -> simplify(Surface)
quad_panels = QuadPanels(Surface=ruled_surface, UDivisions=list_item_3, VDivisions=Slider(1, range=0..10))  # -> simplify(Panels)

# ----
# Obtain weather data
panel_5 = Panel("https://climate.onebuilding.org/WMO_Region_5_Southwest_Pacific/AUS_Australia/NSW_New_South_Wales/AUS_NSW_Sydney.Obs-Observatory.Hill.947680_TMYx.2007-2021.zip")
downloadepw = LBDownloadWeather(weather_URL=panel_5)  # -> epw_file, stat_file, ddy_file; plug-in component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
wea = HBWeaFromEPW(epw_file=downloadepw.epw_file)  # -> wea; plug-in component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

number_slider_3 = Slider(0.89, range=0..1)
surface = Surface(quad_panels)
surface_2 = Surface(quad_panels)
division = Division(A=list_item_6, B=Slider(100, range=0..100))
md_slider = MDSlider(SliderMode=0, slider_value=Point(0.5, 0.5, 0.5), x_domain=Domain(0, 1), y_domain=Domain(0, 1), z_domain=Domain(0, 1))
evaluate_surface = EvaluateSurface(Surface=reparameterize(surface), Point=md_slider)  # -> simplify(Point), Normal, UDirection, VDirection, Frame
scale = Scale(Geometry=surface_2, Center=evaluate_surface.Point, Factor=division)  # -> simplify(graft(Geometry)), Transform
surface_split = SurfaceSplit(Surface=graft(surface_2), Curves=scale.Geometry)
list_item_7 = ListItem(List=surface_split, Index=0, Wrap=True)
deconstruct_brep = DeconstructBrep(Brep=surface_2)  # -> Faces, simplify(Edges), Vertices
brep_join = BrepJoin(Breps=flatten(list_item_7))  # -> Breps, Closed
curve_middle = CurveMiddle(Curve=deconstruct_brep.Edges)  # -> simplify(Midpoint)
settings_speed = SettingsSpeed()
deconstruct = Deconstruct(Point=curve_middle)  # -> XComponent, YComponent, ZComponent
mesh_brep = MeshBrep(Brep=brep_join.Breps, Settings=settings_speed)
mesh_brep_2 = MeshBrep(Brep=scale.Geometry, Settings=settings_speed)
boolean_2 = Boolean(boolean)
sort_list = SortList(Keys=flatten(deconstruct.ZComponent))  # -> Keys, ValuesValuesA
mesh = Mesh(mesh_brep_2)
flip_mesh = FlipMesh(Mesh=mesh_brep, VertexNormals=True, FaceNormals=True, FaceOrientation=True)

# ----
# AmbientLight
number_slider_4 = Slider(5.8, range=0..10)
ambientlight = AmbientLight(Color=ColourSwatch(SwatchColor=RGB(242, 220, 160)), Intensity=number_slider_4)

flip_mesh_2 = FlipMesh(Mesh=mesh, VertexNormals=True, FaceNormals=True, FaceOrientation=True)
list_item_8 = ListItem(List=reverse(sort_list.Keys), Index=0, Wrap=True)
list_item_9 = ListItem(List=reverse(surface_split), Index=0, Wrap=True)
panel_6 = Panel(list_item_8)
subtraction = Subtraction(A=panel_6, B=Slider(0.6, range=0..10))
smaller_than = SmallerThan(FirstNumber=subtraction, SecondNumber=deconstruct.ZComponent)  # -> SmallerThan, OrEqualTo
cull_pattern = CullPattern(List=deconstruct_brep.Edges, CullPattern=smaller_than.SmallerThan)  # -> flatten(List)
join_curves = JoinCurves(Curves=cull_pattern, Preserve=False)

# ---- group: creating room volumes
project = Project(Geometry=join_curves, Plane=PlaneXY(0, 0, 0))  # -> Geometry, Transform
move_2 = Move(Geometry=simplify(graft(project.Geometry)), Motion=unit_z)  # -> simplify(Geometry), Transform
merge_2 = Merge(Data1=simplify(graft(project.Geometry)), Data2=simplify(move_2.Geometry))
cull_index_3 = CullIndex(List=merge_2, Indices="-1", Wrap=True)
unit_z_2 = UnitZ(Factor=number_slider)
boundary_surfaces = BoundarySurfaces(Edges=cull_index_3)
extrude = Extrude(Base=boundary_surfaces, Direction=unit_z_2)

# ---- group: rooms (closed brep)
# Geometry Preparation
geo = Geometry(extrude)
roomsolid = HBRoomFromSolid(geo=flatten(geo), name="TestRoom", conditioned=True)  # -> report, rooms; plug-in component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

# ---- group: boolean toggle for run analysis from website
boolean_3 = Boolean(boolean)
cull_pattern_2 = CullPattern(List=roomsolid.rooms, CullPattern=boolean_3)

# ---- group: glazing (windows)
geometry = Geometry(scale.Geometry)
glassmod = HBGlassModifier(name="g_material", trans="0.8")  # -> modifier; plug-in component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
aperture = HBAperture(geo=geometry, rad_mod=glassmod)  # -> report, apertures; plug-in component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
addsubface = HBAddSubface(hb_obj=flatten(cull_pattern_2), sub_faces=flatten(aperture.apertures))  # -> hb_obj; plug-in component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

# ----
boundary_surfaces_2 = BoundarySurfaces(Edges=join_curves)
unit_z_3 = UnitZ(Factor="-0.5")
settings_speed_2 = SettingsSpeed()
extrude_2 = Extrude(Base=boundary_surfaces_2, Direction=unit_z_3)

# ---- group: shading (surrounding buildings, facade devices)
geometry_2 = Geometry(extrude_2)
shade = HBShade(geo=geometry_2)  # -> report, shades; plug-in component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

# ----
# Model + Grids
number_slider_5 = Slider(5, range=0..10)
gridrooms = HBSensorGridFromRooms(rooms=addsubface, grid_size=number_slider_5)  # -> grid, points, mesh; plug-in component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
model = HBModel(rooms=flatten(addsubface), shades=flatten(shade.shades), name="sample_model_grid")  # -> report, model; plug-in component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
vizwiref = HBVizualizeWireframe(hb_objs=flatten(model.model))  # -> geo; plug-in component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
assigngridsviews = HBAssignGridsAndViews(model=model.model, grids=flatten(gridrooms.grid))  # -> model; plug-in component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

# ----
# Annual Daylight
toggle = BooleanToggle(False)
annualdaylight = HBAnnualDaylight(model=assigngridsviews, wea=wea, run=boolean_2)  # -> out, results, DA, cDA, UDI, UDI_low, UDI_up; plug-in component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
mjoin = MeshJoin(Meshes=gridrooms.mesh)
data = Data(flatten(annualdaylight.DA))
heatmap = LBSpatialHeatmap(values=data, mesh=mjoin)  # -> mesh, legend, title, colors, legend_par, vis_set; plug-in component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

# ---- group: coloured mesh to json
meshcolorfaces = MeshColorFaces(Mesh=heatmap.mesh, Color=heatmap.colors)
meshvertexcolors = MeshVertexColors(Mesh=meshcolorfaces, Name="analysis mesh", DecimalAccuracy=3)

# ----
mesh_brep_3 = MeshBrep(Brep=extrude_2, Settings=settings_speed_2)

standardmat = MeshStandardMaterial(
    Color=flatten(ColourSwatch(SwatchColor=RGB(11, 34, 51))),
    Opacity=Slider(0.9, range=0..1),
    Roughness=1,
    Metalness=Slider(0.5, range=0..1),
    Emissive=RGB(0, 0, 0),
    EmissiveIntensity=1)
standardmat_2 = MeshStandardMaterial(
    Color=flatten(ColourSwatch(SwatchColor=RGB(48, 48, 48))),
    Opacity=1,
    Roughness=1,
    Metalness=0.5,
    Emissive=RGB(0, 0, 0),
    EmissiveIntensity=1)
standardmat_3 = MeshStandardMaterial(
    Color=flatten(ColourSwatch(SwatchColor=RGB(89, 89, 89))),
    Opacity=1,
    Roughness=1,
    Metalness=0.5,
    Emissive=RGB(0, 0, 0),
    EmissiveIntensity=1)
mesh_2 = Mesh(Mesh=flatten(flip_mesh_2), Name="meshStandardMaterial", Material=standardmat, DecimalAccuracy=3)
mesh_3 = Mesh(Mesh=flatten(flip_mesh), Name="meshStandardWireframe", Material=standardmat_3, DecimalAccuracy=3)
mesh_4 = Mesh(Mesh=flatten(mesh_brep_3), Name="meshStandardWireframe", Material=standardmat_2, DecimalAccuracy=3)
scene = CompileScene(Objects=flatten([mesh_2, ambientlight, mesh_3, mesh_4]))

boolean_toggle = BooleanToggle(True)
boolean_toggle_2 = BooleanToggle(True)
file_path_2 = FilePath("C:\Uni\2024\Term 2\CODE2132\web-page\web-page\assets\")
serialize = SerializeObject(Object3d=scene, Minify=boolean_toggle_2, Run=boolean_toggle)
writetxt = WriteTextFile(Path=file_path_2, FileName="facade.json", Data=serialize, Write=boolean_toggle)
panel_7 = Panel(file_path_2)

area = Area(Geometry=list_item_9)  # -> flatten(Area), Centroid
list_length = ListLength(List=flatten(quad_panels))
panel_8 = Panel("""{
"number of glass panes": "panelsx",
"total cost of panels": "costx"
}""")
mass_addition = MassAddition(Input=area.Area)  # -> Result, PartialResults
multiplication = Multiplication(A=mass_addition.Result, B=list_item_5)
round = Round(Number=multiplication)  # -> Nearest, Floor, Ceiling
replace_text_4 = ReplaceText(Text=panel_8, Find="panelsx", Replace=list_length, RecursiveReplace=False)
replace_text_5 = ReplaceText(Text=replace_text_4, Find="costx", Replace=round.Nearest, RecursiveReplace=False)
write_text_file = WriteTextFile(Path=file_path_2, FileName="analysis_data.json", Data=replace_text_5, Write=Toggle(True))

boolean_toggle_3 = BooleanToggle(True)
scene_2 = CompileScene(Objects=flatten(meshvertexcolors))
serialize_2 = SerializeObject(Object3d=scene_2, Minify=boolean_toggle_2, Run=boolean_toggle_3)
writetxt_2 = WriteTextFile(Path=file_path_2, FileName="analysis_mesh.json", Data=serialize_2, Write=boolean_toggle_3)

# ---- group: spider joints
md_slider_2 = MDSlider(SliderMode=0, slider_value=Point(0.5, 0.5, 0.5), x_domain=Domain(0, 1), y_domain=Domain(0, 1), z_domain=Domain(0, 1))  # disabled
evaluate_surface_2 = EvaluateSurface(Surface=reparameterize(surface_2), Point=md_slider_2)  # -> simplify(Point), Normal, UDirection, VDirection, Frame; disabled
number_slider_6 = Slider(0.5, range=0..10)  # disabled
vector_2pt = Vector2Pt(PointA=graft(evaluate_surface_2.Point), PointB=simplify(deconstruct_brep.Vertices), Unitize=False)  # -> Vector, Length; disabled
negative = Negative(Value=number_slider_6)  # disabled
amplitude = Amplitude(Vector=vector_2pt.Vector, Amplitude=negative)  # disabled
flatten_tree = FlattenTree(Tree=deconstruct_brep.Vertices, Path="{0}")  # disabled
number_slider_7 = Slider(4, range=0..10)  # disabled
move_3 = Move(Geometry=deconstruct_brep.Vertices, Motion=amplitude)  # -> flatten(Geometry), Transform; disabled
sort_duplicate_points = SortDuplicatePoints(Points=flatten_tree)  # -> UniquePoints, Indices; disabled
number_slider_8 = Slider(0.1, range=0..0.1)  # disabled
addition = Addition(A=number_slider_6, B=number_slider_8)  # disabled
closest_points = ClosestPoints(Point=graft(sort_duplicate_points.UniquePoints), Cloud=move_3.Geometry, Count=number_slider_7)  # -> ClosestPoint, CPIndex, Distance; disabled
larger_than = LargerThan(FirstNumber=closest_points.Distance, SecondNumber=addition)  # -> LargerThan, OrEqualTo; disabled
number_slider_9 = Slider(3, range=0..10)  # disabled
cull_pattern_3 = CullPattern(List=closest_points.ClosestPoint, CullPattern=invert(larger_than.LargerThan))  # -> simplify(List); disabled
list_length_2 = ListLength(List=cull_pattern_3)  # disabled
larger_than_2 = LargerThan(FirstNumber=list_length_2, SecondNumber=number_slider_9)  # -> LargerThan, OrEqualTo; disabled
cull_pattern_4 = CullPattern(List=cull_pattern_3, CullPattern=larger_than_2.LargerThan)  # disabled
number_slider_10 = Slider(0.1, range=0..0.1)  # disabled
cull_pattern_5 = CullPattern(List=cull_pattern_3, CullPattern=invert(larger_than_2.LargerThan))  # disabled
polyline = PolyLine(Vertices=cull_pattern_5, Closed=False)  # disabled
list_item_10 = ListItem(List=cull_pattern_4, Index=0, Wrap=True)  # -> Item, Item1, Item2; disabled
plane_3pt = Plane3Pt(PointA=list_item_10.Item, PointB=list_item_10.Item1, PointC=list_item_10.Item2)  # -> simplify(Plane); disabled
curve_middle_2 = CurveMiddle(Curve=polyline)  # disabled
unit_z_4 = UnitZ(Factor=number_slider_10)  # disabled
end_points = EndPoints(Curve=polyline)  # -> Start, End; disabled
move_4 = Move(Geometry=curve_middle_2, Motion=unit_z_4)  # -> Geometry, Transform; disabled
number_slider_11 = Slider(0.6, range=0..1)  # disabled
plane_3pt_2 = Plane3Pt(PointA=end_points.Start, PointB=move_4.Geometry, PointC=end_points.End)  # -> simplify(Plane); disabled
merge_3 = Merge(Data1=plane_3pt_2, Data2=plane_3pt)  # disabled
deconstruct_plane = DeconstructPlane(Plane=merge_3)  # -> Origin, XAxis, YAxis, ZAxis; disabled
amplitude_2 = Amplitude(Vector=deconstruct_plane.ZAxis, Amplitude=number_slider_11)  # disabled
negative_2 = Negative(Value=amplitude_2)  # disabled
move_5 = Move(Geometry=graft(sort_duplicate_points.UniquePoints), Motion=[amplitude_2, negative_2])  # -> Geometry, Transform; disabled
number_slider_12 = Slider(2, range=0..10)  # disabled
point_in_curves = PointInCurves(Point=move_5.Geometry, Curves=join_curves)  # -> simplify(Relationship), Index, Point; disabled
equality = Equality(FirstNumber=point_in_curves.Relationship, SecondNumber=number_slider_12)  # -> Equality, Inequality; disabled
cull_pattern_6 = CullPattern(List=move_5.Geometry, CullPattern=equality.Equality)  # -> simplify(List); disabled
number_slider_13 = Slider(40, range=0..100)  # disabled
line = Line(StartPoint=simplify(cull_pattern_6), EndPoint=cull_pattern_3)  # disabled
end_points_2 = EndPoints(Curve=line)  # -> Start, End; disabled
radians = Radians(Degrees=number_slider_13)  # disabled
plane_3pt_3 = Plane3Pt(PointA=end_points_2.Start, PointB=simplify(graft(sort_duplicate_points.UniquePoints)), PointC=end_points_2.End)  # disabled
number_slider_14 = Slider(0.62, range=0..1)  # disabled
rotate = Rotate(Geometry=line, Angle=radians, Plane=plane_3pt_3)  # -> Geometry, Transform; disabled
list_item_11 = ListItem(List=cull_pattern_3, Index=0, Wrap=True)  # -> Item, Item1, Item2, Item3; disabled
evaluate_curve = EvaluateCurve(Curve=reparameterize(rotate.Geometry), Parameter=number_slider_14)  # -> Point, Tangent, Angle; disabled
graft_tree = GraftTree(Tree=evaluate_curve.Point, IncludeEmptyLists=True, IncludeNullItems=True)  # disabled
list_item_12 = ListItem(List=evaluate_curve.Point, Index=0, Wrap=True)  # -> Item, Item1, Item2, Item3; disabled
merge_4 = Merge(Data1=cull_pattern_6, Data2=list_item_12.Item1, Data3=list_item_11.Item1)  # disabled
merge_5 = Merge(Data1=cull_pattern_6, Data2=list_item_12.Item, Data3=list_item_11.Item)  # disabled
merge_6 = Merge(Data1=cull_pattern_6, Data2=list_item_12.Item2, Data3=list_item_11.Item2)  # disabled
merge_7 = Merge(Data1=cull_pattern_6, Data2=list_item_12.Item3, Data3=list_item_11.Item3)  # disabled
polyline_2 = PolyLine(Vertices=merge_5, Closed=False)  # disabled
polyline_3 = PolyLine(Vertices=merge_4, Closed=False)  # disabled
polyline_4 = PolyLine(Vertices=merge_6, Closed=False)  # disabled
polyline_5 = PolyLine(Vertices=merge_7, Closed=False)  # disabled
merge_8 = Merge(Data1=polyline_2, Data2=polyline_3, Data3=polyline_4, Data4=polyline_5)  # disabled
number_slider_15 = Slider(0.07, range=0..0.1)  # disabled
multipipe = MultiPipe(Curves=merge_8, NodeSize=number_slider_15, EndOffset=1, StrutSize=1, Segment=0, KinkAngle=0.6, CubeFit=0, Caps=0)  # disabled
