# Grasshopper definition map.gh (Grasshopper 1.0.7)
# plug-ins: ClipperComponents, ShapeDiverForGrasshopper, Urbano, Bifocals

sddp = ShapeDiverDocumentPayload({AbsoluteTolerance=0, AngleTolerance=0, DistanceDisplayPrecision=0, GltfVersion="Gltf2", InputGroups="{}", OutputGroups="{}", RelativeTolerance=0, UnitSystem=0, VersionCreated="1.13.1.0", VersionSaved="1.13.1.0"})

# ---- group: bbox coords
file_path = FilePath("C:\Uni\2024\Term 2\CODE2132\sabri-web-page\web-page\assets\bbox.json")

# ----
read_file = ReadFile(File=file_path, PerLineParse=True)

# ---- group: amenity data
file_path_2 = FilePath("C:\Uni\2024\Term 2\CODE2132\sabri-web-page\web-page\assets\amenity_data.geojson")

# ---- group: transport data
file_path_3 = FilePath("C:\Uni\2024\Term 2\CODE2132\sabri-web-page\web-page\assets\transport_data.geojson")

# ---- group: highway data
file_path_4 = FilePath("C:\Uni\2024\Term 2\CODE2132\sabri-web-page\web-page\assets\highway_data.geojson")

# ---- group: building data
file_path_5 = FilePath("C:\Uni\2024\Term 2\CODE2132\sabri-web-page\web-page\assets\building_data.geojson")

# ---- group: point data
file_path_6 = FilePath("C:\Uni\2024\Term 2\CODE2132\sabri-web-page\web-page\assets\point.json")

# ----
panel = Panel("""0
-1""")
read_file_2 = ReadFile(File=file_path_2, PerLineParse=True)
read_file_3 = ReadFile(File=file_path_4, PerLineParse=True)
read_file_4 = ReadFile(File=file_path_6, PerLineParse=True)
read_file_5 = ReadFile(File=file_path_5, PerLineParse=True)
read_file_6 = ReadFile(File=file_path_3, PerLineParse=True)
cull_index = CullIndex(List=read_file, Indices=panel, Wrap=True)
panel_2 = Panel(read_file_4)
replace_text = ReplaceText(Text=read_file_5, Find=" ", RecursiveReplace=False)
replace_text_2 = ReplaceText(Text=read_file_3, Find=" ", RecursiveReplace=False)
text_split = TextSplit(Text=cull_index, Separators=":")
replace_text_3 = ReplaceText(Text=read_file_2, Find=" ", RecursiveReplace=False)
construct_point = ConstructPoint(XCoordinate=0, YCoordinate=0, ZCoordinate=0)
replace_text_4 = ReplaceText(Text=read_file_6, Find=" ", RecursiveReplace=False)
text_join = TextJoin(Text=replace_text)
panel_3 = Panel("""-1
0""")
text_join_2 = TextJoin(Text=replace_text_2)
text_join_3 = TextJoin(Text=replace_text_3)
text_join_4 = TextJoin(Text=replace_text_4)
cull_index_2 = CullIndex(List=panel_2, Indices=panel_3, Wrap=True)
cull_index_3 = CullIndex(List=text_split, Indices="0", Wrap=True)
ghpython_script = GhPythonScript(geojson_data=text_join_2, origin_pt=construct_point)  # -> out, a; inputs origin_pt: Point3d
# ---------- ghpython_script: Python ----------
import rhinoscriptsyntax as rs
import json
import math
import System
from Grasshopper import DataTree
from Grasshopper.Kernel.Data import GH_Path

def latlon_to_meters(lat, lon, origin_lat, origin_lon):
    # Constants for GDA94 / MGA zone 56 (EPSG:28356)
    # Central meridian (Longitude) for zone 56
    cm = 153.0
    k0 = 0.9996
    false_easting = 500000.0
    false_northing = 10000000.0 if lat < 0 else 0.0

    # Ellipsoid parameters (GRS80 / WGS84)
    a = 6378137.0
    f = 1 / 298.257222101
    b = a * (1 - f)
    e = math.sqrt(1 - (b / a) ** 2)
    e2 = e ** 2 / (1 - e ** 2)

    lat_rad = math.radians(lat)
    lon_rad = math.radians(lon)
    cm_rad = math.radians(cm)

    nu = a / math.sqrt(1 - e ** 2 * math.sin(lat_rad) ** 2)
    p = lon_rad - cm_rad

    A = (lon_rad - cm_rad) * math.cos(lat_rad)
    T = math.tan(lat_rad) ** 2
    C = e2 * math.cos(lat_rad) ** 2
    M = a * ((1 - e ** 2 / 4 - 3 * e ** 4 / 64 - 5 * e ** 6 / 256) * lat_rad
             - (3 * e ** 2 / 8 + 3 * e ** 4 / 32 + 45 * e ** 6 / 1024) * math.sin(2 * lat_rad)
             + (15 * e ** 4 / 256 + 45 * e ** 6 / 1024) * math.sin(4 * lat_rad)
             - (35 * e ** 6 / 3072) * math.sin(6 * lat_rad))

    x = false_easting + k0 * nu * (A + (1 - T + C) * A ** 3 / 6 + (5 - 18 * T + T ** 2 + 72 * C - 58 * e2) * A ** 5 / 120)
    y = false_northing + k0 * (M + nu * math.tan(lat_rad) * (A ** 2 / 2 + (5 - T + 9 * C + 4 * C ** 2) * A ** 4 / 24
                         + (61 - 58 * T + T ** 2 + 600 * C - 330 * e2) * A ** 6 / 720))

    return x, y

def geojson_to_rhino_points(geojson_data, origin_pt):
    origin_lat = origin_pt.Y  # Assuming origin_pt.Y is latitude
    origin_lon = origin_pt.X  # Assuming origin_pt.X is longitude
    
    geojson = json.loads(geojson_data)
    features = geojson.get('features', [])
    data_tree = DataTree[System.Object]()
    
    for i, feature in enumerate(features):
        geometry = feature.get('geometry', {})
        geom_type = geometry.get('type', '')
        coordinates = geometry.get('coordinates', [])
        
        path = GH_Path(i)
        
        if geom_type == 'Point':
            x, y = latlon_to_meters(coordinates[1], coordinates[0], origin_lat, origin_lon)
            pt = rs.CreatePoint(x, y, 0)
            data_tree.Add(pt, path)
            
        elif geom_type == 'LineString':
            for coord in coordinates:
                x, y = latlon_to_meters(coord[1], coord[0], origin_lat, origin_lon)
                pt = rs.CreatePoint(x, y, 0)
                data_tree.Add(pt, path)
            
        elif geom_type == 'Polygon':
            for polygon in coordinates:
                for coord in polygon:
                    x, y = latlon_to_meters(coord[1], coord[0], origin_lat, origin_lon)
                    pt = rs.CreatePoint(x, y, 0)
                    data_tree.Add(pt, path)
    
    return data_tree

# Inputs (from Grasshopper)
geojson_data_string = geojson_data  # GeoJSON data as string
origin_pt = origin_pt  # Rhino origin point (Point3d)

# Convert GeoJSON points to Rhino points
rhino_points = geojson_to_rhino_points(geojson_data_string, origin_pt)

# Output the results (in Grasshopper)
a = rhino_points
# ---------- end ghpython_script ----------
ghpython_script_2 = GhPythonScript(geojson_data=text_join, origin_pt=construct_point)  # -> out, a; inputs origin_pt: Point3d; same code as ghpython_script
ghpython_script_3 = GhPythonScript(geojson_data=text_join_3, origin_pt=construct_point)  # -> out, a; inputs origin_pt: Point3d; same code as ghpython_script
ghpython_script_4 = GhPythonScript(geojson_data=text_join_4, origin_pt=construct_point)  # -> out, a; inputs origin_pt: Point3d; same code as ghpython_script
replace_text_5 = ReplaceText(Text=cull_index_3, Find="\"", RecursiveReplace=False)
text_split_2 = TextSplit(Text=cull_index_2, Separators=":")
polyline = PolyLine(Vertices=ghpython_script_2.a, Closed=False)
polyline_2 = PolyLine(Vertices=ghpython_script.a, Closed=False)
text_split_3 = TextSplit(Text=replace_text_5, Separators=",")
point = Point(ghpython_script_3.a)
point_2 = Point(ghpython_script_4.a)
text_split_4 = TextSplit(Text=text_split_2, Separators="\"")  # -> simplify(Result)
explode = Explode(Curve=[polyline_2, polyline], Recursive=True)  # -> Segments, flatten(Vertices)
list_item = ListItem(List=text_split_3, Index=0, Wrap=True)  # -> Item, Item1, Item2, Item3
trim_tree = TrimTree(Tree=text_split_4, Depth=1)
merge = Merge(Data1=explode.Vertices, Data2=flatten(point_2))
panel_4 = Panel(list_item.Item)
panel_5 = Panel(list_item.Item1)
panel_6 = Panel(list_item.Item2)
panel_7 = Panel(list_item.Item3)
list_item_2 = ListItem(List=trim_tree, Index="4", Wrap=True)
average = Average(Input=flatten(merge))
file_path_7 = FilePath("C:\Uni\2024\Term 2\CODE2132\sabri-web-page\web-page\assets\")
list_item_3 = ListItem(List=flatten(list_item_2), Index=0, Wrap=True)  # -> Item, Item1
download_openstreetmap_osm = DownloadOpenStreetMapOSM(
    LeftBound=panel_5,
    RightBound=panel_7,
    TopBound=panel_6,
    BottomBound=panel_4,
    FilePath=file_path_7,
    RunToggle=Toggle(True))  # -> OSMQueryURL, OSMFilePath
vector_2pt = Vector2Pt(PointA=average, PointB=construct_point, Unitize=False)  # -> Vector, Length
construct_point_2 = ConstructPoint(XCoordinate=list_item_3.Item, YCoordinate=list_item_3.Item1, ZCoordinate=0)
move = Move(Geometry=point, Motion=vector_2pt.Vector)  # -> Geometry, Transform
move_2 = Move(Geometry=polyline_2, Motion=vector_2pt.Vector)  # -> Geometry, Transform
move_3 = Move(Geometry=polyline, Motion=vector_2pt.Vector)  # -> Geometry, Transform
move_4 = Move(Geometry=point_2, Motion=vector_2pt.Vector)  # -> Geometry, Transform
import_osm_features = ImportOSMFeatures(OSMPathOrURL=download_openstreetmap_osm.OSMQueryURL, OSMFeatureType="building", Format="xml", ImportAltitude=False)  # -> Points, Metadata, UTMZone, TranslationVector
import_osm_features_2 = ImportOSMFeatures(OSMPathOrURL=download_openstreetmap_osm.OSMQueryURL, OSMFeatureType="amenity", Format="xml", ImportAltitude=False)  # -> Points, Metadata, UTMZone, TranslationVector
import_osm_features_3 = ImportOSMFeatures(OSMPathOrURL=download_openstreetmap_osm.OSMQueryURL, OSMFeatureType="street", Format="xml", ImportAltitude=False)  # -> Points, Metadata, UTMZone, TranslationVector
area = Area(Geometry=move_3.Geometry)  # -> Area, flatten(Centroid)
polyline_offset = PolylineOffset(
    Polylines=move_2.Geometry,
    Distance=Slider(5, range=0..10),
    Plane=Plane(origin=(0, 0, 0), x=(0, 0, 0), y=(0, 0, 0)),
    Tolerance=0.001,
    ClosedFillet=1,
    OpenFillet=1,
    Miter=2)  # -> Contour, Holes
polyline_3 = PolyLine(Vertices=import_osm_features_3.Points, Closed=False)
polyline_4 = PolyLine(Vertices=import_osm_features.Points, Closed=False)
geometry = Geometry(polyline_offset.Contour)
create_street_network = CreateStreetNetwork(
    StreetCurves=flatten(polyline_3),
    Metadata=flatten(import_osm_features_3.Metadata),
    SplitStreetCurves=True,
    UTMZone=import_osm_features_3.UTMZone,
    TranslationVector=import_osm_features_3.TranslationVector)  # -> StreetNetwork, StreetSegmentCurves, UTMZone, TranslationVector
create_amenity = CreateAmenity(PointLocationOfAmenity=import_osm_features_2.Points, Metadata=import_osm_features_2.Metadata)
polyline_offset_2 = PolylineOffset(
    Polylines=polyline_3,
    Distance=Slider(5, range=0..10),
    Plane=Plane(origin=(0, 0, 0), x=(0, 0, 0), y=(0, 0, 0)),
    Tolerance=0.001,
    ClosedFillet=1,
    OpenFillet=1,
    Miter=2)  # -> Contour, Holes
region_union = RegionUnion(Curves=flatten(geometry))
area_2 = Area(Geometry=region_union)  # -> Area, Centroid
arrange_amenities_by_building = ArrangeAmenitiesByBuilding(Amenities=flatten(create_amenity), Buildings=flatten(polyline_4))  # -> AmenitiesByBuilding, Buildings
region_union_2 = RegionUnion(Curves=flatten(polyline_offset_2.Contour))
bounding_box = BoundingBox(Content=region_union, Plane=PlaneXY(0, 0, 0))  # -> Box, Box_2
larger_than = LargerThan(FirstNumber=area_2.Area, SecondNumber=Slider(600, range=0..10000))  # -> LargerThan, OrEqualTo
cull_index_4 = CullIndex(List=region_union_2, Indices="0", Wrap=True)
area_3 = Area(Geometry=bounding_box.Box)  # -> Area, Centroid
area_4 = Area(Geometry=cull_index_4)  # -> Area, Centroid
cull_pattern = CullPattern(List=region_union, CullPattern=larger_than.LargerThan)
create_building = CreateBuilding(
    BuildingCurve=polyline_4,
    Metadata=import_osm_features.Metadata,
    AmenitiesInBuilding=arrange_amenities_by_building.AmenitiesByBuilding)
sort_list = SortList(Keys=area_3.Area, ValuesValuesA=bounding_box.Box)  # -> Keys, ValuesValuesA
area_5 = Area(Geometry=cull_pattern)  # -> Area, Centroid
smaller_than = SmallerThan(FirstNumber=area_4.Area, SecondNumber=Slider(1035, range=0..10000))  # -> SmallerThan, OrEqualTo
list_item_4 = ListItem(List=reverse(sort_list.ValuesValuesA), Index=0, Wrap=True)
build_urbano_model = BuildUrbanoModel(Buildings=flatten(create_building), StreetNetwork=create_street_network.StreetNetwork, BuildToggle=True)  # -> UrbanoModel, BuildingCurves, Activities
smaller_than_2 = SmallerThan(FirstNumber=area_5.Area, SecondNumber=Slider(18168, range=0..100000))  # -> SmallerThan, OrEqualTo
cull_pattern_2 = CullPattern(List=cull_index_4, CullPattern=invert(smaller_than.SmallerThan))
area_6 = Area(Geometry=cull_pattern_2)  # -> Area, Centroid
cull_pattern_3 = CullPattern(List=cull_pattern, CullPattern=smaller_than_2.SmallerThan)
inspect_building = InspectBuilding(Building=build_urbano_model.BuildingCurves, DefaultHeight=10)  # -> Geometry, Metadata, Amenity, BuildingMesh
larger_than_2 = LargerThan(FirstNumber=area_6.Area, SecondNumber=Slider(8000, range=0..10000))  # -> LargerThan, OrEqualTo
point_in_curves = PointInCurves(Point=area.Centroid, Curves=graft(cull_pattern_3))  # -> Relationship, Index, Point
cull_pattern_4 = CullPattern(List=cull_pattern_2, CullPattern=invert(larger_than_2.LargerThan))
bounding_box_2 = BoundingBox(Content=flatten(build_urbano_model.BuildingCurves), Plane=PlaneXY(0, 0, 0), UnionBox=True)  # -> Box, Box_2
mass_addition = MassAddition(Input=point_in_curves.Relationship)  # -> Result, PartialResults
area_7 = Area(Geometry=cull_pattern_4)  # -> Area, Centroid
larger_than_3 = LargerThan(FirstNumber=mass_addition.Result, SecondNumber=0)  # -> simplify(LargerThan), OrEqualTo
evaluate_surface = EvaluateSurface(Surface=reparameterize(bounding_box_2.Box), Point=construct_point_2)  # -> Point, Normal, UDirection, VDirection, Frame
point_3 = Point(area_7.Centroid)
number_slider = Slider(150, range=0..1000)
closest_point = ClosestPoint(Point=evaluate_surface.Point, Cloud=flatten(point_3))  # -> ClosestPoint, CPIndex, Distance
cull_pattern_5 = CullPattern(List=simplify(graft(cull_pattern_3)), CullPattern=invert(larger_than_3.LargerThan))
rectangle = Rectangle(Plane=PlaneXY(0, 0, 0), XSize=number_slider, YSize=number_slider, Radius=0)  # -> Rectangle, Length
router = Router(
    RouterUrbanoModelOrStreetNetwork=build_urbano_model.UrbanoModel,
    Origin=closest_point.ClosestPoint,
    Destination=create_amenity,
    TravelMode="pedestrian",
    TimeLimit=-1)  # -> Trip, Route, simplify(Time), Distance
area_8 = Area(Geometry=cull_pattern_5)  # -> Area, Centroid
bounding_box_3 = BoundingBox(Content=flatten(move_2.Geometry), Plane=PlaneXY(0, 0, 0), UnionBox=True)  # -> Box, Box_2
max_walk_time_mins = Slider(9.5, range=0..45)
area_9 = Area(Geometry=rectangle.Rectangle)  # -> Area, Centroid
polyline_offset_3 = PolylineOffset(
    Polylines=cull_pattern_5,
    Distance=Slider(5, range=0..10),
    Plane=Plane(origin=(0, 0, 0), x=(0, 0, 0), y=(0, 0, 0)),
    Tolerance=0.001,
    ClosedFillet=1,
    OpenFillet=1,
    Miter=2)  # -> Contour, Holes
evaluate_surface_2 = EvaluateSurface(Surface=reparameterize(bounding_box_3.Box), Point=construct_point_2)  # -> Point, Normal, UDirection, VDirection, Frame
smaller_than_3 = SmallerThan(FirstNumber=router.Time, SecondNumber=max_walk_time_mins)  # -> SmallerThan, OrEqualTo
trip_walkscore = TripWalkscore(Trip=router.Trip)  # -> flatten(Walkscore)
boundary_surfaces = BoundarySurfaces(Edges=polyline_offset_3.Contour)
closest_point_2 = ClosestPoint(Point=evaluate_surface_2.Point, Cloud=flatten(area_8.Centroid))  # -> ClosestPoint, CPIndex, Distance
sort_list_2 = SortList(Keys=trip_walkscore)  # -> Keys, ValuesA
dispatch = Dispatch(List=router.Trip, DispatchPattern=smaller_than_3.OrEqualTo)  # -> ListA, ListB
area_10 = Area(Geometry=boundary_surfaces)  # -> Area, Centroid
construct_point_3 = ConstructPoint(XCoordinate=0, YCoordinate=0, ZCoordinate=0)
orient = Orient(Geometry=rectangle.Rectangle, Source=area_9.Centroid, Target=closest_point_2.ClosestPoint)  # -> Geometry, Transform
list_item_5 = ListItem(List=sort_list_2.Keys, Index=0, Wrap=True)  # -> Item1, Item
average_2 = Average(Input=sort_list_2.Keys)
inspect_trip = InspectTrip(Trip=dispatch.ListA)  # -> Origin, Destination, Time, Distance, Route, Mode, People, Activity, Amenity
distance = Distance(PointA=area_10.Centroid, PointB=construct_point_3)
boundary_surfaces_2 = BoundarySurfaces(Edges=orient.Geometry)
construct_domain = ConstructDomain(DomainStart=Slider(16, range=0..100), DomainEnd=Slider(30, range=0..100))
bounds = Bounds(Numbers=flatten(distance))
geometry_2 = Geometry(inspect_trip.Route)
unit_z = UnitZ(Factor=Slider(100, range=0..100))
remap_numbers = RemapNumbers(Value=distance, Source=bounds, Target=construct_domain)  # -> Mapped, Clipped
extrude = Extrude(Base=boundary_surfaces_2, Direction=unit_z)
unit_z_2 = UnitZ(Factor=remap_numbers.Mapped)
custom_preview = CustomPreview(
    Geometry=extrude,
    Material={diffuse=RGB(221, 160, 221), emission=RGB(66, 48, 66), shine=0.5, specular=RGB(255, 255, 255), transparency=0})
extrude_2 = Extrude(Base=boundary_surfaces, Direction=unit_z_2)
