# Grasshopper definition wavy_fins_2.gh (Grasshopper 1.0.7)
# plug-ins: ShapeDiverForGrasshopper, Pufferfish, LunchBox, Triceratops, Bifocals, Parakeet, Shortest Walk in Gh, Urbano, ClipperComponents

honeybee = Honeybee_Honeybee()  # -> out; plug-in component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
ladybug = Ladybug_Ladybug()  # -> out; plug-in component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
panel = Panel(honeybee)

# ---- group: bbox coords
bbox_coords = FilePath("C:\Uni\2024\Term 2\CODE2132\sabri-web-page\web-page\assets\bbox.json")

# ---- group: point data
point_data = FilePath("C:\Uni\2024\Term 2\CODE2132\sabri-web-page\web-page\assets\point.json")

# ----
standardmat = MeshStandardMaterial(
    Color=flatten(ColourSwatch(SwatchColor=RGB(180, 193, 204))),
    Opacity=1,
    Roughness=1,
    Metalness=Slider(0.5, range=0..1),
    Emissive=RGB(0, 0, 0),
    EmissiveIntensity=1)
standardmat_2 = MeshStandardMaterial(
    Color=flatten(ColourSwatch(SwatchColor=RGB(128, 119, 111))),
    Opacity=1,
    Roughness=1,
    Metalness=0.5,
    Emissive=RGB(0, 0, 0),
    EmissiveIntensity=1)
standardmat_3 = MeshStandardMaterial(
    Color=flatten(ColourSwatch(SwatchColor=RGB(43, 195, 255))),
    Opacity=Slider(0.55, range=0..1),
    Roughness=1,
    Metalness=Slider(0, range=0..100),
    Emissive=RGB(0, 0, 0),
    EmissiveIntensity=1)

file_path = FilePath("C:\Uni\2024\Term 2\CODE2132\sabri-web-page\web-page\assets\config.json")
read_file = ReadFile(File=file_path, PerLineParse=True)
sddp = ShapeDiverDocumentPayload({AbsoluteTolerance=0, AngleTolerance=0, DistanceDisplayPrecision=0, GltfVersion="Gltf2", InputGroups="{}", OutputGroups="{}", RelativeTolerance=0, UnitSystem=0, VersionCreated="1.13.1.0", VersionSaved="1.13.1.0"})
panel_2 = Panel(read_file)
panel_3 = Panel("""0
-1""")
cull_index = CullIndex(List=panel_2, Indices=panel_3, Wrap=True)
panel_4 = Panel(cull_index)
text_split = TextSplit(Text=panel_4, Separators=":")
replace_text = ReplaceText(Text=text_split, Find="\"", RecursiveReplace=False)
replace_text_2 = ReplaceText(Text=replace_text, Find=",", RecursiveReplace=False)
replace_text_3 = ReplaceText(Text=replace_text_2, Find=" ", RecursiveReplace=False)  # -> simplify(Result)
panel_5 = Panel(replace_text_3)
list_item = ListItem(List=panel_5, Index="1", Wrap=True)  # -> flatten(Item)

# ---- group: FLOOR HEIGHT
list_item_2 = ListItem(List=list_item, Index=0, Wrap=True)

# ----
unit_z = UnitZ(Factor=list_item_2)

# ---- group: FLOOR NUM
list_item_3 = ListItem(List=list_item, Index="1", Wrap=True)

# ---- group: ATTRACTOR PT SEED
list_item_4 = ListItem(List=list_item, Index="2", Wrap=True)

# ---- group: ATTRACTOR PT STRENGTH
list_item_5 = ListItem(List=list_item, Index="3", Wrap=True)

# ---- group: RUN ANALYSIS
list_item_6 = ListItem(List=list_item, Index="4", Wrap=True)

# ----
boolean_toggle = BooleanToggle(True)
runanalysis = Boolean(list_item_6)
floor_height = Slider(1.5, range=0..10)
floor_num = Slider(16, range=0..100)
file_path_2 = FilePath("C:\Uni\2024\Term 2\CODE2132\sabri-web-page\web-page\assets\")
base_curve_small = Curve(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)
base_curve_large = Curve(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)
panel_6 = Panel("https://climate.onebuilding.org/WMO_Region_5_Southwest_Pacific/AUS_Australia/NSW_New_South_Wales/AUS_NSW_Sydney.Obs-Observatory.Hill.947680_TMYx.2007-2021.zip")
series = Series(Start=0, Step=list_item_2, Count=list_item_3)
panel_7 = Panel(file_path_2)
unit_z_2 = UnitZ(Factor=series)
downloadepw = LBDownloadWeather(weather_URL=panel_6)  # -> epw_file, stat_file, ddy_file; plug-in component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
move = Move(Geometry=base_curve_large, Motion=unit_z_2)  # -> Geometry, Transform

# ----
# MAP STUFF
assets_folder = FilePath("C:\Uni\2024\Term 2\CODE2132\sabri-web-page\web-page\assets\")
file_path_3 = FilePath("C:\Uni\2024\Term 2\CODE2132\sabri-web-page\web-page\assets\mapConfig.json")
read_file_2 = ReadFile(File=file_path_3, PerLineParse=True)
read_file_3 = ReadFile(File=bbox_coords, PerLineParse=True)
panel_8 = Panel("""0
-1""")
panel_9 = Panel("""0
-1""")
cull_index_2 = CullIndex(List=read_file_2, Indices=panel_8, Wrap=True)
read_file_4 = ReadFile(File=point_data, PerLineParse=True)
cull_index_3 = CullIndex(List=read_file_3, Indices=panel_9, Wrap=True)
panel_10 = Panel(read_file_4)
text_split_2 = TextSplit(Text=cull_index_2, Separators=":")
text_split_3 = TextSplit(Text=cull_index_3, Separators=":")
panel_11 = Panel("""-1
0""")
cull_index_4 = CullIndex(List=text_split_2, Indices="0", Wrap=True)
cull_index_5 = CullIndex(List=panel_10, Indices=panel_11, Wrap=True)
cull_index_6 = CullIndex(List=text_split_3, Indices="0", Wrap=True)
replace_text_4 = ReplaceText(Text=cull_index_4, Find=",", RecursiveReplace=False)
replace_text_5 = ReplaceText(Text=cull_index_6, Find="\"", RecursiveReplace=False)
text_split_4 = TextSplit(Text=cull_index_5, Separators=":")
text_split_5 = TextSplit(Text=replace_text_5, Separators=",")
list_item_7 = ListItem(List=flatten(replace_text_4), Index=0, Wrap=True)  # -> Item, Item1, Item2
text_split_6 = TextSplit(Text=text_split_4, Separators="\"")  # -> simplify(Result)
list_item_8 = ListItem(List=text_split_5, Index=0, Wrap=True)  # -> Item, Item1, Item2, Item3
trim_tree = TrimTree(Tree=text_split_6, Depth=1)
panel_12 = Panel(list_item_8.Item)
panel_13 = Panel(list_item_8.Item1)
panel_14 = Panel(list_item_8.Item2)
panel_15 = Panel(list_item_8.Item3)
list_item_9 = ListItem(List=trim_tree, Index="4", Wrap=True)
list_item_10 = ListItem(List=flatten(list_item_9), Index=0, Wrap=True)  # -> Item, Item1
download_openstreetmap_osm = DownloadOpenStreetMapOSM(
    LeftBound=panel_13,
    RightBound=panel_15,
    TopBound=panel_14,
    BottomBound=panel_12,
    FilePath=assets_folder,
    RunToggle=Toggle(True))  # -> OSMQueryURL, OSMFilePath
construct_point = ConstructPoint(XCoordinate=list_item_10.Item, YCoordinate=list_item_10.Item1, ZCoordinate=0)
import_osm_features = ImportOSMFeatures(OSMPathOrURL=download_openstreetmap_osm.OSMQueryURL, OSMFeatureType="building", Format="xml", ImportAltitude=False)  # -> Points, Metadata, UTMZone, TranslationVector
import_osm_features_2 = ImportOSMFeatures(OSMPathOrURL=download_openstreetmap_osm.OSMQueryURL, OSMFeatureType="amenity", Format="xml", ImportAltitude=False)  # -> Points, Metadata, UTMZone, TranslationVector
import_osm_features_3 = ImportOSMFeatures(OSMPathOrURL=download_openstreetmap_osm.OSMQueryURL, OSMFeatureType="street", Format="xml", ImportAltitude=False)  # -> Points, Metadata, UTMZone, TranslationVector
polyline = PolyLine(Vertices=import_osm_features_3.Points, Closed=False)
polyline_2 = PolyLine(Vertices=import_osm_features.Points, Closed=False)
create_street_network = CreateStreetNetwork(
    StreetCurves=flatten(polyline),
    Metadata=flatten(import_osm_features_3.Metadata),
    SplitStreetCurves=True,
    UTMZone=import_osm_features_3.UTMZone,
    TranslationVector=import_osm_features_3.TranslationVector)  # -> StreetNetwork, StreetSegmentCurves, UTMZone, TranslationVector
create_amenity = CreateAmenity(PointLocationOfAmenity=import_osm_features_2.Points, Metadata=import_osm_features_2.Metadata)
polyline_offset = PolylineOffset(
    Polylines=polyline,
    Distance=Slider(5, range=0..10),
    Plane=Plane(origin=(0, 0, 0), x=(0, 0, 0), y=(0, 0, 0)),
    Tolerance=0.001,
    ClosedFillet=1,
    OpenFillet=1,
    Miter=2)  # -> Contour, Holes
arrange_amenities_by_building = ArrangeAmenitiesByBuilding(Amenities=flatten(create_amenity), Buildings=flatten(polyline_2))  # -> AmenitiesByBuilding, Buildings
region_union = RegionUnion(Curves=flatten(polyline_offset.Contour))
cull_index_7 = CullIndex(List=region_union, Indices="0", Wrap=True)
area = Area(Geometry=cull_index_7)  # -> Area, Centroid
create_building = CreateBuilding(
    BuildingCurve=polyline_2,
    Metadata=import_osm_features.Metadata,
    AmenitiesInBuilding=arrange_amenities_by_building.AmenitiesByBuilding)
smaller_than = SmallerThan(FirstNumber=area.Area, SecondNumber=list_item_7.Item2)  # -> SmallerThan, OrEqualTo
build_urbano_model = BuildUrbanoModel(Buildings=flatten(create_building), StreetNetwork=create_street_network.StreetNetwork, BuildToggle=True)  # -> UrbanoModel, BuildingCurves, Activities
cull_pattern = CullPattern(List=cull_index_7, CullPattern=invert(smaller_than.SmallerThan))
max_block_size_sqm = Slider(8000, range=0..10000)
area_2 = Area(Geometry=cull_pattern)  # -> Area, Centroid
inspect_building = InspectBuilding(Building=build_urbano_model.BuildingCurves, DefaultHeight=10)  # -> Geometry, Metadata, Amenity, BuildingMesh
larger_than = LargerThan(FirstNumber=area_2.Area, SecondNumber=list_item_7.Item1)  # -> LargerThan, OrEqualTo
cull_pattern_2 = CullPattern(List=cull_pattern, CullPattern=invert(larger_than.LargerThan))
bounding_box = BoundingBox(Content=flatten(build_urbano_model.BuildingCurves), Plane=PlaneXY(0, 0, 0), UnionBox=True)  # -> Box, Box_2
area_3 = Area(Geometry=cull_pattern_2)  # -> Area, Centroid
unit_z_3 = UnitZ(Factor=1)
boundary_surfaces = BoundarySurfaces(Edges=cull_pattern_2)
evaluate_surface = EvaluateSurface(Surface=reparameterize(bounding_box.Box), Point=construct_point)  # -> Point, Normal, UDirection, VDirection, Frame
point = Point(area_3.Centroid)
extrude = Extrude(Base=boundary_surfaces, Direction=unit_z_3)
closest_point = ClosestPoint(Point=evaluate_surface.Point, Cloud=flatten(point))  # -> ClosestPoint, CPIndex, Distance
area_4 = Area(Geometry=base_curve_large)  # -> Area, Centroid
loft = Loft(Curves=move.Geometry, Options={Adjust=False, Closed=False, LoftEnds=0, LoftSimp=0, LoftType=0, Rebuild=10, Refit=0.01})
router = Router(
    RouterUrbanoModelOrStreetNetwork=build_urbano_model.UrbanoModel,
    Origin=closest_point.ClosestPoint,
    Destination=create_amenity,
    TravelMode="pedestrian",
    TimeLimit=-1)  # -> Trip, Route, simplify(Time), Distance
list_item_11 = ListItem(List=extrude, Index=closest_point.CPIndex, Wrap=True)
cull_index_8 = CullIndex(List=extrude, Indices=closest_point.CPIndex, Wrap=True)
building_envelope = Brep(loft)
orient = Orient(Geometry=building_envelope, Source=area_4.Centroid, Target=closest_point.ClosestPoint)  # -> Geometry, Transform
cap_holes = CapHoles(Brep=orient.Geometry)
smaller_than_2 = SmallerThan(FirstNumber=router.Time, SecondNumber=list_item_7.Item)  # -> SmallerThan, OrEqualTo
trip_walkscore = TripWalkscore(Trip=router.Trip)  # -> flatten(Walkscore)
building_envelope_placed = Brep(cap_holes)
sort_list = SortList(Keys=trip_walkscore)  # -> Keys, ValuesValuesA
dispatch = Dispatch(List=router.Trip, DispatchPattern=smaller_than_2.OrEqualTo)  # -> ListA, ListB
list_item_12 = ListItem(List=sort_list.Keys, Index=0, Wrap=True)  # -> Item1, Item
average = Average(Input=sort_list.Keys)
inspect_trip = InspectTrip(Trip=dispatch.ListA)  # -> Origin, Destination, Time, Distance, Route, Mode, People, Activity, Amenity
panel_16 = Panel("""{
    "maxWalkScore": MaxWalk,
    "minWalkScore": MinWalk,
    "meanWalkScore": MeanWalk
  }""")
geometry = Geometry(inspect_trip.Route)
replace_text_6 = ReplaceText(Text=panel_16, Find="MaxWalk", Replace=list_item_12.Item1, RecursiveReplace=False)
replace_text_7 = ReplaceText(Text=replace_text_6, Find="MinWalk", Replace=list_item_12.Item, RecursiveReplace=False)
replace_text_8 = ReplaceText(Text=replace_text_7, Find="MeanWalk", Replace=average, RecursiveReplace=False)
write_text_file = WriteTextFile(Path=assets_folder, FileName="mapAnalysis.json", Data=replace_text_8, Write=Toggle(True))
linebasicmaterial = LineBasicMaterial(Color=ColourSwatch(SwatchColor=RGB(57, 227, 133)), LineWidth=Slider(5, range=0..10))
meshbasicmaterial = MeshBasicMaterial(Color=ColourSwatch(SwatchColor=RGB(34, 91, 153)))
linebasicmaterial_2 = LineBasicMaterial(Color=ColourSwatch(SwatchColor=RGB(0, 0, 0)), LineWidth=Slider(1.5, range=0..10))
meshbasicmaterial_2 = MeshBasicMaterial(Color=ColourSwatch(SwatchColor=RGB(52, 192, 227)))
meshbasicmaterial_3 = MeshBasicMaterial(Color=ColourSwatch(SwatchColor=RGB(227, 52, 52)))
meshbasicmaterial_4 = MeshBasicMaterial(Color=ColourSwatch(SwatchColor=RGB(101, 113, 130)))
line = Line(Line=flatten(geometry), LineMaterial=linebasicmaterial, DecimalAccuracy=3)
mesh = Mesh(Mesh=cull_index_8, Material=meshbasicmaterial, DecimalAccuracy=3)
mesh_2 = Mesh(Mesh=building_envelope_placed, Material=meshbasicmaterial_2, DecimalAccuracy=3)
mesh_3 = Mesh(Mesh=list_item_11, Material=meshbasicmaterial_3, DecimalAccuracy=3)
mesh_4 = Mesh(Mesh=inspect_building.BuildingMesh, Material=meshbasicmaterial_4, DecimalAccuracy=3)
line_2 = Line(Line=polyline, LineMaterial=linebasicmaterial_2, DecimalAccuracy=3)
compile_scene = CompileScene(Objects=flatten([mesh_4, line_2, mesh_3, mesh, line, mesh_2]))
boolean_toggle_2 = BooleanToggle(True)
serializeobject = SerializeObject(Object3d=compile_scene, Minify=boolean_toggle_2, Run=boolean_toggle_2)
write_text_file_2 = WriteTextFile(Path=assets_folder, FileName="map.json", Data=serializeobject, Write=boolean_toggle_2)

number_slider = Slider(200, range=0..1000)
wea = HBWeaFromEPW(epw_file=downloadepw.epw_file)  # -> wea; plug-in component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
divide_curve = DivideCurve(Curve=move.Geometry, Count=number_slider, Kinks=False)  # -> Points, Tangents, Parameters
list_length = ListLength(List=move.Geometry)
flip_matrix = FlipMatrix(Data=divide_curve.Points)
division = Division(A=list_length, B="2")
polyline_3 = PolyLine(Vertices=flip_matrix, Closed=False)  # -> simplify(Polyline)
list_item_13 = ListItem(List=move.Geometry, Index=division, Wrap=True)

number_slider_2 = Slider(15, range=0..100)
area_5 = Area(Geometry=list_item_13)  # -> Area, Centroid
divide_curve_2 = DivideCurve(Curve=list_item_13, Count=number_slider_2, Kinks=False)  # -> Points, Tangents, Parameters
construct_domain = ConstructDomain(DomainStart=Slider(1, range=0..5), DomainEnd=Slider(8, range=0..10))
vector_2pt = Vector2Pt(PointA=area_5.Centroid, PointB=divide_curve_2.Points, Unitize=False)  # -> Vector, Length
random = Random(Range=construct_domain, Number=number_slider_2, Seed=list_item_4)
amplitude = Amplitude(Vector=vector_2pt.Vector, Amplitude=random)
construct_domain_2 = ConstructDomain(DomainStart=Slider(-8, range=-10..10), DomainEnd=Slider(8, range=-10..10))
move_2 = Move(Geometry=divide_curve_2.Points, Motion=amplitude)  # -> Geometry, Transform
random_2 = Random(Range=construct_domain_2, Number=number_slider_2, Seed=list_item_4)
unit_z_4 = UnitZ(Factor=random_2)
move_3 = Move(Geometry=move_2.Geometry, Motion=unit_z_4)  # -> Geometry, Transform
interpolate = Interpolate(Vertices=move_3.Geometry, Degree=3, Periodic=Toggle(True), KnotStyle=1)  # -> Curve, Length, Domain

attractor_pt_random_seed = Slider(0, range=0..100)
divide_curve_3 = DivideCurve(Curve=polyline_3, Count=list_item_3, Kinks=False)  # -> simplify(Points), Tangents, Parameters
area_6 = Area(Geometry=move.Geometry)  # -> Area, Centroid
divide_curve_4 = DivideCurve(Curve=interpolate.Curve, Count=number_slider, Kinks=False)  # -> Points, Tangents, Parameters
line_3 = Line(StartPoint=graft(divide_curve_4.Points), EndPoint=simplify(divide_curve_3.Points))  # -> simplify(Line)
attractor_point_strength = Slider(0.12, range=0.1..0.5)
length = Length(Curve=line_3)
multiplication = Multiplication(A=length, B=list_item_5)

file_path_4 = FilePath("C:\Uni\2024\Term 2\CODE2132\sabri-web-page\web-page\assets\floorsConfig.json")
read_file_5 = ReadFile(File=file_path_4, PerLineParse=True)
panel_17 = Panel(read_file_5)
panel_18 = Panel("""0
-1""")
cull_index_9 = CullIndex(List=panel_17, Indices=panel_18, Wrap=True)
panel_19 = Panel(cull_index_9)
text_split_7 = TextSplit(Text=panel_19, Separators=":")
replace_text_9 = ReplaceText(Text=text_split_7, Find="\"", RecursiveReplace=False)
replace_text_10 = ReplaceText(Text=replace_text_9, Find=",", RecursiveReplace=False)
replace_text_11 = ReplaceText(Text=replace_text_10, Find=" ", RecursiveReplace=False)  # -> simplify(Result)
panel_20 = Panel(replace_text_11)
list_item_14 = ListItem(List=panel_20, Index="1", Wrap=True)  # -> flatten(Item)

vector_2pt_2 = Vector2Pt(PointA=area_6.Centroid, PointB=divide_curve_3.Points, Unitize=False)  # -> Vector, Length
amplitude_2 = Amplitude(Vector=vector_2pt_2.Vector, Amplitude=multiplication)
move_4 = Move(Geometry=divide_curve_3.Points, Motion=amplitude_2)  # -> Geometry, Transform
polyline_4 = PolyLine(Vertices=move_4.Geometry, Closed=False)  # -> simplify(Polyline)

number_slider_3 = Slider(50, range=0..1000)
loft_2 = Loft(Curves=move.Geometry, Options={Adjust=False, Closed=False, LoftEnds=0, LoftSimp=0, LoftType=0, Rebuild=10, Refit=0.01})
quad_panels = QuadPanels(Surface=loft_2, UDivisions=10, VDivisions=number_slider_3)
custom_preview = CustomPreview(Geometry=quad_panels, Material=ColourSwatch(SwatchColor=RGBA(43, 195, 255, 136)))

loft_3 = Loft(
    Curves=[polyline_4, polyline_3],
    Options={Adjust=False, Closed=False, LoftEnds=0, LoftSimp=0, LoftType=0, Rebuild=10, Refit=0.01})
number_slider_4 = Slider(0.1, range=0..0.1)
offset_surface = OffsetSurface(Surface=loft_3, Distance=number_slider_4, BothSides=number_slider_4, CreateSolid=True)
custom_preview_2 = CustomPreview(Geometry=offset_surface, Material=ColourSwatch(SwatchColor=RGB(148, 148, 148)))

boundary_surfaces_2 = BoundarySurfaces(Edges=move.Geometry)
custom_preview_3 = CustomPreview(Geometry=boundary_surfaces_2, Material=ColourSwatch(SwatchColor=RGB(128, 114, 102)))

area_7 = Area(Geometry=quad_panels)  # -> Area, Centroid
area_8 = Area(Geometry=quad_panels)  # -> Area, Centroid
unit_z_5 = UnitZ(Factor=Slider(0.5, range=0..1))
mesh_brep = MeshBrep(
    Brep=offset_surface,
    Settings={GridMaxCount=0, GridMinCount=16, JaggedSeams=False, MaxEdgeLength=0, MinEdgeLength=0.0001, MinTolerance=0, Refine=True, RefineAngle=0, RelativeTolerance=0.65, SimplePlanes=True, Tolerance=0})
fins = Mesh(mesh_brep)
mesh_5 = Mesh(Mesh=flatten(fins), Name="meshStandardMaterial", Material=standardmat, DecimalAccuracy=3)
scale = Scale(Geometry=quad_panels, Center=area_7.Centroid, Factor=Slider(0.98, range=0..1))  # -> Geometry, Transform
deconstruct_brep = DeconstructBrep(Brep=scale.Geometry)  # -> Faces, simplify(Edges), Vertices
number_slider_5 = Slider(0.1, range=0..0.1)
list_item_15 = ListItem(List=deconstruct_brep.Edges, Index=0, Wrap=True)  # -> Item1, Item
split_list = SplitList(List=flatten(list_item_15.Item1), Index=number_slider_3)  # -> ListA, ListB
offset_surface_2 = OffsetSurface(Surface=quad_panels, Distance=number_slider_5, Retrim=True)
offset_surface_3 = OffsetSurface(Surface=scale.Geometry, Distance=number_slider_5, Retrim=True)
area_9 = Area(Geometry=loft_3)  # -> flatten(Area), Centroid
join_curves_plus = JoinCurvesPlus(Curves=split_list.ListA, Tolerance=Slider(0.1, range=0..10), Preserve=False)
project = Project(Geometry=join_curves_plus, Plane=PlaneXY(0, 0, 0))  # -> Geometry, Transform
move_5 = Move(Geometry=project.Geometry, Motion=unit_z_2)  # -> Geometry, Transform
merge = Merge(Data1=project.Geometry, Data2=move_5.Geometry)
cull_index_10 = CullIndex(List=merge, Indices="-1", Wrap=True)  # -> flatten(List)
boundary_surfaces_3 = BoundarySurfaces(Edges=cull_index_10)  # -> flatten(Surfaces)
extrude_2 = Extrude(Base=boundary_surfaces_3, Direction=unit_z)

# ---- group: rooms (closed brep)
# Geometry Preparation
geo = Geometry(extrude_2)
panel_21 = Panel("ScrapeDaSky")
roomsolid = HBRoomFromSolid(geo=flatten(geo), name=panel_21, conditioned=True)  # -> report, rooms; plug-in component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

# ---- group: boolean toggle for run analysis from website
boolean = Boolean(Toggle(False))
cull_pattern_3 = CullPattern(List=roomsolid.rooms, CullPattern=boolean)

# ---- group: glazing (windows)
glassmod = HBGlassModifier(name="g_material", trans="0.8")  # -> modifier; plug-in component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
geometry_2 = Geometry(scale.Geometry)
aperture = HBAperture(geo=geometry_2, name=panel_21, rad_mod=glassmod)  # -> report, apertures; plug-in component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
addsubface = HBAddSubface(hb_obj=flatten(cull_pattern_3), sub_faces=flatten(aperture.apertures))  # -> hb_obj; plug-in component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

# ----
boolean_2 = Boolean(boolean)
end_points = EndPoints(Curve=split_list.ListA)  # -> Start, End
extrude_3 = Extrude(Base=boundary_surfaces_2, Direction=unit_z_5)
list_length_2 = ListLength(List=area_8.Area)  # -> flatten(Length)
mass_addition = MassAddition(Input=flatten(area_8.Area))  # -> Result, PartialResults
floors = Curve(move.Geometry)
mesh_brep_2 = MeshBrep(
    Brep=offset_surface_3,
    Settings={GridMaxCount=0, GridMinCount=16, JaggedSeams=False, MaxEdgeLength=0, MinEdgeLength=0.0001, MinTolerance=0, Refine=True, RefineAngle=0, RelativeTolerance=0.65, SimplePlanes=True, Tolerance=0})
glazing = Mesh(mesh_brep_2)
mesh_6 = Mesh(Mesh=flatten(glazing), Name="meshStandardWireframe", Material=standardmat_3, DecimalAccuracy=3)
mesh_brep_3 = MeshBrep(
    Brep=offset_surface_2,
    Settings={GridMaxCount=0, GridMinCount=16, JaggedSeams=False, MaxEdgeLength=0, MinEdgeLength=0.0001, MinTolerance=0, Refine=True, RefineAngle=0, RelativeTolerance=0.65, SimplePlanes=True, Tolerance=0})
glazing_frames = Mesh(mesh_brep_3)
polyline_5 = PolyLine(Vertices=end_points.Start, Closed=Toggle(True))
mass_addition_2 = MassAddition(Input=area_9.Area)  # -> Result, PartialResults
list_length_3 = ListLength(List=area_9.Area)
mesh_brep_4 = MeshBrep(
    Brep=extrude_3,
    Settings={GridMaxCount=0, GridMinCount=16, JaggedSeams=False, MaxEdgeLength=0, MinEdgeLength=0.0001, MinTolerance=0, Refine=True, RefineAngle=0, RelativeTolerance=0.65, SimplePlanes=True, Tolerance=0})
floors_2 = Mesh(mesh_brep_4)
mesh_7 = Mesh(Mesh=flatten(floors_2), Name="meshStandardWireframe", Material=standardmat_2, DecimalAccuracy=3)
scene = CompileScene(Objects=flatten([mesh_5, mesh_6, mesh_7]))

# ---- group: shading (surrounding buildings, facade devices)
geometry_3 = Geometry(flatten([fins, floors_2, glazing_frames]))
shade = HBShade(geo=geometry_3)  # -> report, shades; plug-in component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

# ----
serialize = SerializeObject(Object3d=scene, Minify=Toggle(True), Run=boolean_toggle)

# ----
# Model + Grids
number_slider_6 = Slider(5, range=0..10)
gridrooms = HBSensorGridFromRooms(rooms=addsubface, grid_size=number_slider_6)  # -> grid, points, mesh; plug-in component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
model = HBModel(
    rooms=flatten(cull_pattern_3),
    shades=flatten(shade.shades),
    apertures=flatten(aperture.apertures),
    name="sample_model_grid")  # -> report, model; plug-in component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
vizwiref = HBVizualizeWireframe(hb_objs=flatten(model.model))  # -> geo; plug-in component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
assigngridsviews = HBAssignGridsAndViews(model=model.model, grids=flatten(gridrooms.grid))  # -> model; plug-in component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

writetxt = WriteTextFile(Path=file_path_2, FileName="facade.json", Data=serialize, Write=boolean_toggle)

# ----
# Annual Daylight
annualdaylight = HBAnnualDaylight(model=assigngridsviews, wea=wea, run=boolean_2)  # -> out, results, DA, cDA, UDI, UDI_low, UDI_up; plug-in component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
mjoin = MeshJoin(Meshes=gridrooms.mesh)
data = Data(flatten(annualdaylight.DA))
heatmap = LBSpatialHeatmap(values=data, mesh=mjoin)  # -> mesh, legend, title, colors, legend_par, vis_set; plug-in component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

# ---- group: coloured mesh to json
meshcolorfaces = MeshColorFaces(Mesh=heatmap.mesh, Color=heatmap.colors)
meshvertexcolors = MeshVertexColors(Mesh=meshcolorfaces, Name="analysis mesh", DecimalAccuracy=3)

# ----
boolean_toggle_3 = BooleanToggle(True)
scene_2 = CompileScene(Objects=flatten(meshvertexcolors))
serialize_2 = SerializeObject(Object3d=scene_2, Minify=boolean_toggle_3, Run=boolean_toggle_3)
writetxt_2 = WriteTextFile(Path=file_path_2, FileName="analysis_mesh.json", Data=serialize_2, Write=boolean_toggle_3)

grid_divisions = Slider(7, range=0..20)
boundary_surfaces_4 = BoundarySurfaces(Edges=floors)  # -> simplify(graft(Surfaces))
price_sqm = Panel("970")
co2e_sqm = Panel("118.3")
round = Round(Number=mass_addition_2.Result)  # -> Nearest, Floor, Ceiling

# ---- group: GRID DIVISION NUM
list_item_16 = ListItem(List=list_item_14, Index=0, Wrap=True)

# ---- group: CULL CURVE SCALE FACTOR
list_item_17 = ListItem(List=list_item_14, Index="1", Wrap=True)

# ---- group: MIN OFFICE SIZE
list_item_18 = ListItem(List=list_item_14, Index="2", Wrap=True)

# ---- group: LIFT X
list_item_19 = ListItem(List=list_item_14, Index="3", Wrap=True)

# ---- group: LIFT Y
list_item_20 = ListItem(List=list_item_14, Index="4", Wrap=True)

# ---- group: PATH SUBD
list_item_21 = ListItem(List=list_item_14, Index="5", Wrap=True)

# ----
price_sqm_2 = Panel("330")
multiplication_2 = Multiplication(A=mass_addition.Result, B=price_sqm)
multiplication_3 = Multiplication(A=mass_addition.Result, B=co2e_sqm)
co2e_sqm_2 = Panel("6.15")
series_2 = Series(Start=0, Step=Slider(2, range=0..10), Count=Slider(180, range=0..1000))
round_2 = Round(Number=multiplication_2)  # -> Nearest, Floor, Ceiling
round_3 = Round(Number=multiplication_3)  # -> Nearest, Floor, Ceiling
multiplication_4 = Multiplication(A=round.Ceiling, B=co2e_sqm_2)
multiplication_5 = Multiplication(A=round.Ceiling, B=price_sqm_2)
xy_plane = XYPlane(Origin=Point(0, 0, 0))
radians = Radians(Degrees=series_2)
cull_curve_scale_factor = Slider(0.75, range=0..1)
round_4 = Round(Number=multiplication_4)  # -> Nearest, Floor, Ceiling
grid_structure = GridStructure(Surface=floors, UDivisions=list_item_16, VDivisions=list_item_16)  # -> simplify(StructureLines), StructureNodes
number_of_panels = Panel(list_length_2)
total_cost_glass = Panel(round_2.Ceiling)
total_carbon_glass = Panel(round_3.Ceiling)
area_10 = Area(Geometry=floors)  # -> Area, Centroid
rotate = Rotate(Geometry=xy_plane, Angle=radians, Plane=PlaneXY(0, 0, 0))  # -> Geometry, Transform
panel_22 = Panel("""{
"number of glass panes": "panelsx",
"total cost of panels": "panelscostx",
"total embodied carbon of panels": "panelscarbonx",
"number of metal fins": "finsx",
"total cost of metal fins": "finscostx",
"total embodied carbon of fins": "finscarbonx"
}""")
number_of_fins = Panel(list_length_3)
total_cost_fins = Panel(multiplication_5)
total_carbon_fins = Panel(round_4.Ceiling)
surface_split = SurfaceSplit(Surface=boundary_surfaces_4, Curves=grid_structure.StructureLines)  # -> simplify(Fragments)
bounding_box_2 = BoundingBox(Content=floors, Plane=rotate.Geometry)  # -> Box, Box_2
scale_2 = Scale(Geometry=floors, Center=area_10.Centroid, Factor=list_item_17)  # -> Geometry, Transform
trim_tree_2 = TrimTree(Tree=bounding_box_2.Box, Depth=1)
surface_split_2 = SurfaceSplit(Surface=boundary_surfaces_4, Curves=graft(scale_2.Geometry))  # -> simplify(Fragments)
area_11 = Area(Geometry=surface_split)  # -> Area, Centroid
area_12 = Area(Geometry=trim_tree_2)  # -> Area, Centroid
replace_text_12 = ReplaceText(Text=panel_22, Find="panelsx", Replace=number_of_panels, RecursiveReplace=False)
list_item_22 = ListItem(List=surface_split_2, Index=0, Wrap=True)
sort_list_2 = SortList(Keys=area_12.Area, ValuesValuesA=trim_tree_2)  # -> Keys, ValuesValuesA
unit_z_6 = UnitZ(Factor=1)
replace_text_13 = ReplaceText(Text=replace_text_12, Find="panelscostx", Replace=total_cost_glass, RecursiveReplace=False)
list_item_23 = ListItem(List=sort_list_2.ValuesValuesA, Index=0, Wrap=True)
negative = Negative(Value=unit_z_6)
replace_text_14 = ReplaceText(Text=replace_text_13, Find="panelscarbonx", Replace=total_carbon_glass, RecursiveReplace=False)
replace_text_15 = ReplaceText(Text=replace_text_14, Find="finsx", Replace=number_of_fins, RecursiveReplace=False)
replace_text_16 = ReplaceText(Text=replace_text_15, Find="finscostx", Replace=total_cost_fins, RecursiveReplace=False)
extrude_4 = Extrude(Base=list_item_22, Direction=[unit_z_6, negative])
point_in_brep = PointInBrep(Brep=extrude_4, Point=area_11.Centroid, Strict=False)
area_13 = Area(Geometry=floors)  # -> Area, Centroid
deconstruct_plane = DeconstructPlane(Plane=list_item_23)  # -> Origin, XAxis, YAxis, ZAxis
replace_text_17 = ReplaceText(Text=replace_text_16, Find="finscarbonx", Replace=total_carbon_fins, RecursiveReplace=False)
cull_pattern_4 = CullPattern(List=surface_split, CullPattern=point_in_brep)
construct_plane = ConstructPlane(Origin=area_13.Centroid, XAxis=deconstruct_plane.XAxis, YAxis=deconstruct_plane.YAxis)
min_office_size_sqm = Slider(13, range=0..100)
panel_23 = Panel(replace_text_17)
area_14 = Area(Geometry=cull_pattern_4)  # -> Area, Centroid
lift_size_x = Slider(1.4, range=0..10)
larger_than_2 = LargerThan(FirstNumber=area_14.Area, SecondNumber=list_item_18)  # -> LargerThan, OrEqualTo
lift_size_y = Slider(1.6, range=0..10)
# Up to 5 Floors: One elevator
# 
# 6 to 10 Floors: Two elevators
# 
# 11 to 20 Floors: Three elevators
# 
# 21 to 30 Floors: Four elevators
# 
# 31 Floors and Above: Five with one additional elevator typically added for every additional 10-20 floors.
ghpython_script = GhPythonScript(x=list_item_3)  # -> a; inputs x: Int32
# ---------- ghpython_script: Python ----------
import rhinoscriptsyntax as rs

def calculate_elevators(floornum):
    # Determine the number of elevators based on the number of floors
    if floornum <= 5:
        elevators = 1
    elif 6 <= floornum <= 10:
        elevators = 2
    elif 11 <= floornum <= 20:
        elevators = 3
    elif 21 <= floornum <= 30:
        elevators = 4
    else:
        elevators = 4 + (floornum - 30) // 10
    
    return elevators

# Inputs from Grasshopper
floornum = x  # Input parameter x represents the number of floors

# Calculate the number of elevators
elevators = calculate_elevators(floornum)

# Output to Grasshopper
a = elevators
# ---------- end ghpython_script ----------
write_text_file_3 = WriteTextFile(Path=file_path_2, FileName="analysis_data.json", Data=replace_text_17, Write=Toggle(True))
cull_pattern_5 = CullPattern(List=cull_pattern_4, CullPattern=larger_than_2.LargerThan)
number_of_elevators = Panel(ghpython_script)
multiplication_6 = Multiplication(A=list_item_20, B=ghpython_script)
multiplication_7 = Multiplication(A=list_item_19, B="2")
list_length_4 = ListLength(List=cull_pattern_5)
division_2 = Division(A=multiplication_7, B="2")
division_3 = Division(A=multiplication_6, B="2")
negative_2 = Negative(Value=division_2)
negative_3 = Negative(Value=division_3)
list_item_24 = ListItem(List=cull_pattern_5, Index=expr("x/2", list_length_4), Wrap=True)
list_item_25 = ListItem(List=cull_pattern_5, Index=0, Wrap=True)
division_4 = Division(A=list_length_4, B="2")
construct_domain_3 = ConstructDomain(DomainStart=division_2, DomainEnd=negative_2)
construct_domain_4 = ConstructDomain(DomainStart=division_3, DomainEnd=negative_3)
merge_2 = Merge(Data1=list_length_4, Data2=division_4)
rectangle = Rectangle(Plane=construct_plane, XSize=construct_domain_3, YSize=construct_domain_4, Radius=0)  # -> Rectangle, Length
cull_index_11 = CullIndex(List=cull_pattern_5, Indices=merge_2, Wrap=True)  # -> simplify(List)
explode = Explode(Curve=rectangle.Rectangle, Recursive=True)  # -> Segments, Vertices

area_15 = Area(Geometry=cull_index_11)  # -> Area, Centroid
custom_preview_4 = CustomPreview(Geometry=cull_index_11, Material=ColourSwatch(SwatchColor=RGB(227, 50, 50)))
text_tag = TextTag(Location=area_15.Centroid, Text="MEETING")

area_16 = Area(Geometry=list_item_24)  # -> Area, Centroid
custom_preview_5 = CustomPreview(Geometry=list_item_24, Material=ColourSwatch(SwatchColor=RGB(227, 170, 0)))
text_tag_2 = TextTag(Location=area_16.Centroid, Text="KITCHEN")

area_17 = Area(Geometry=list_item_25)  # -> Area, Centroid
custom_preview_6 = CustomPreview(Geometry=list_item_25, Material=ColourSwatch(SwatchColor=RGB(0, 227, 53)))
text_tag_3 = TextTag(Location=area_17.Centroid, Text="BATHROOMS")

boundary_surfaces_5 = BoundarySurfaces(Edges=boundary_surfaces_4)
custom_preview_7 = CustomPreview(Geometry=boundary_surfaces_5, Material=ColourSwatch(SwatchColor=RGBA(217, 137, 174, 66)))

length_2 = Length(Curve=explode.Segments)
sort_list_3 = SortList(Keys=length_2, ValuesValuesA=explode.Segments)  # -> Keys, ValuesValuesA
list_item_26 = ListItem(List=sort_list_3.ValuesValuesA, Index=0, Wrap=True)  # -> Item, Item1
area_18 = Area(Geometry=cull_index_11)  # -> Area, Centroid
curve_middle = CurveMiddle(Curve=list_item_26.Item)
curve_middle_2 = CurveMiddle(Curve=list_item_26.Item1)
line_4 = Line(StartPoint=curve_middle, EndPoint=curve_middle_2)
surface_split_3 = SurfaceSplit(Surface=graft(rectangle.Rectangle), Curves=simplify(line_4))  # -> simplify(Fragments)
list_item_27 = ListItem(List=reverse(surface_split_3), Index=0, Wrap=True)
explode_2 = Explode(Curve=list_item_27, Recursive=True)  # -> Segments, Vertices
length_3 = Length(Curve=explode_2.Segments)
sort_list_4 = SortList(Keys=length_3, ValuesValuesA=explode_2.Segments)  # -> Keys, ValuesValuesA
list_item_28 = ListItem(List=reverse(sort_list_4.ValuesValuesA), Index=0, Wrap=True)  # -> Item, Item1
divide_curve_5 = DivideCurve(Curve=list_item_28.Item1, Count=number_of_elevators, Kinks=False)  # -> Points, Tangents, Parameters
curve_closest_point = CurveClosestPoint(Point=divide_curve_5.Points, Curve=list_item_28.Item)  # -> Point, Parameter, Distance
line_5 = Line(StartPoint=simplify(divide_curve_5.Points), EndPoint=simplify(curve_closest_point.Point))
fire_path_subd = Slider(200, range=0..500)
surface_split_4 = SurfaceSplit(Surface=list_item_27, Curves=line_5)
unit_z_7 = UnitZ(Factor="0.1")
tree_branch = TreeBranch(Tree=simplify(surface_split_4), Path="0", MaintainPaths=True)

list_item_29 = ListItem(List=surface_split_3, Index=0, Wrap=True)
area_19 = Area(Geometry=list_item_29)  # -> Area, Centroid
custom_preview_8 = CustomPreview(Geometry=list_item_29, Material=ColourSwatch(SwatchColor=RGB(50, 56, 227)))
text_tag_4 = TextTag(Location=area_19.Centroid, Text="STAIRCASE")

negative_4 = Negative(Value=unit_z_7)

area_20 = Area(Geometry=surface_split_4)  # -> Area, Centroid
text_tag_5 = TextTag(Location=area_20.Centroid, Text="LIFT")
custom_preview_9 = CustomPreview(Geometry=surface_split_4, Material=ColourSwatch(SwatchColor=RGB(50, 227, 203)))

tree_branch_2 = TreeBranch(Tree=boundary_surfaces_4, Path="0", MaintainPaths=True)
extrude_5 = Extrude(Base=graft(tree_branch), Direction=[unit_z_7, negative_4])
grid_structure_2 = GridStructure(Surface=tree_branch_2, UDivisions=list_item_21, VDivisions=list_item_21)  # -> StructureLines, StructureNodes
solid_union = SolidUnion(Breps=flatten(extrude_5))
trim_with_brep = TrimWithBrep(Curve=grid_structure_2.StructureLines, Brep=solid_union)  # -> Inside, flatten(Outside)
tree_branch_3 = TreeBranch(Tree=area_18.Centroid, Path="0", MaintainPaths=True)  # -> graft(Branch)
curve = Curve(trim_with_brep.Outside)
tree_branch_4 = TreeBranch(Tree=area_17.Centroid, Path="0", MaintainPaths=True)
tree_branch_5 = TreeBranch(Tree=area_16.Centroid, Path="0", MaintainPaths=True)
merge_3 = Merge(Data1=flatten(tree_branch_4), Data2=flatten(tree_branch_5), Data3=flatten(tree_branch_3))  # -> simplify(graft(Result))
unit_z_8 = UnitZ(Factor="-0.1")
unit_z_9 = UnitZ(Factor="0.1")
tree_branch_6 = TreeBranch(Tree=area_19.Centroid, Path="0", MaintainPaths=True)
line_6 = Line(StartPoint=merge_3, EndPoint=tree_branch_6)
area_21 = Area(Geometry=list_item_29)  # -> Area, Centroid
area_22 = Area(Geometry=list_item_25)  # -> Area, Centroid
area_23 = Area(Geometry=list_item_24)  # -> Area, Centroid
area_24 = Area(Geometry=surface_split_4)  # -> Area, Centroid
area_25 = Area(Geometry=cull_index_11)  # -> Area, Centroid
shortest_walk = ShortestWalk(Curves=curve, WantedPath=line_6)  # -> simplify(ShortestWalk), Succession, Direction, flatten(Length)
scale_3 = Scale(Geometry=list_item_29, Center=area_21.Centroid, Factor="0.96")  # -> Geometry, Transform
scale_4 = Scale(Geometry=list_item_25, Center=area_22.Centroid, Factor="0.96")  # -> Geometry, Transform
scale_5 = Scale(Geometry=list_item_24, Center=area_23.Centroid, Factor="0.96")  # -> Geometry, Transform
scale_6 = Scale(Geometry=surface_split_4, Center=area_24.Centroid, Factor="0.96")  # -> Geometry, Transform
scale_7 = Scale(Geometry=cull_index_11, Center=area_25.Centroid, Factor="0.96")  # -> Geometry, Transform
project_2 = Project(Geometry=shortest_walk.ShortestWalk, Plane=flatten(boundary_surfaces_4))  # -> Geometry, Transform
sort_list_5 = SortList(Keys=shortest_walk.Length)  # -> Keys, ValuesValuesA
extrude_6 = Extrude(Base=scale_7.Geometry, Direction=unit_z_9)
extrude_7 = Extrude(Base=scale_3.Geometry, Direction=unit_z_9)
extrude_8 = Extrude(Base=scale_5.Geometry, Direction=unit_z_9)
meshstandardmaterial = MeshStandardMaterial(
    Color=ColourSwatch(SwatchColor=RGB(255, 255, 255)),
    Opacity=1,
    Roughness=1,
    Metalness=Slider(0, range=0..100),
    Emissive=RGB(0, 0, 0),
    EmissiveIntensity=1)
meshstandardmaterial_2 = MeshStandardMaterial(
    Color=ColourSwatch(SwatchColor=RGB(113, 201, 54)),
    Opacity=1,
    Roughness=1,
    Metalness=Slider(0, range=0..100),
    Emissive=RGB(0, 0, 0),
    EmissiveIntensity=1)
meshstandardmaterial_3 = MeshStandardMaterial(
    Color=ColourSwatch(SwatchColor=RGB(255, 245, 105)),
    Opacity=1,
    Roughness=1,
    Metalness=Slider(0, range=0..100),
    Emissive=RGB(0, 0, 0),
    EmissiveIntensity=1)
meshstandardmaterial_4 = MeshStandardMaterial(
    Color=ColourSwatch(SwatchColor=RGB(242, 90, 90)),
    Opacity=1,
    Roughness=1,
    Metalness=Slider(0, range=0..100),
    Emissive=RGB(0, 0, 0),
    EmissiveIntensity=1)
meshstandardmaterial_5 = MeshStandardMaterial(
    Color=ColourSwatch(SwatchColor=RGB(142, 105, 255)),
    Opacity=1,
    Roughness=1,
    Metalness=Slider(0, range=0..100),
    Emissive=RGB(0, 0, 0),
    EmissiveIntensity=1)
extrude_9 = Extrude(Base=scale_6.Geometry, Direction=unit_z_9)
meshstandardmaterial_6 = MeshStandardMaterial(
    Color=ColourSwatch(SwatchColor=RGB(100, 220, 250)),
    Opacity=1,
    Roughness=1,
    Metalness=Slider(0, range=0..100),
    Emissive=RGB(0, 0, 0),
    EmissiveIntensity=1)
extrude_10 = Extrude(Base=scale_4.Geometry, Direction=unit_z_9)
extrude_11 = Extrude(Base=boundary_surfaces_5, Direction=unit_z_8)
unit_z_10 = UnitZ(Factor=expr("x*1.1", "0.1"))
highest_lowest_numbers = HighestLowestNumbers(Numbers=sort_list_5.Keys)  # -> Highest, Lowest
panel_24 = Panel("""{
   "maxWalk": maxWalkX,
   "maxWalkSpeed": maxSpeed,
   "minWalk": minWalkX,
   "minWalkSpeed": minSpeed
}""")
linebasicmaterial_3 = LineBasicMaterial(Color=ColourSwatch(SwatchColor=RGB(0, 0, 0)), LineWidth=Slider(5, range=0..10))
mesh_brep_5 = MeshBrep(
    Brep=extrude_11,
    Settings={GridMaxCount=0, GridMinCount=16, JaggedSeams=False, MaxEdgeLength=0, MinEdgeLength=0.0001, MinTolerance=0, Refine=True, RefineAngle=0, RelativeTolerance=0.65, SimplePlanes=True, Tolerance=0})
mesh_brep_6 = MeshBrep(
    Brep=extrude_10,
    Settings={GridMaxCount=0, GridMinCount=16, JaggedSeams=False, MaxEdgeLength=0, MinEdgeLength=0.0001, MinTolerance=0, Refine=True, RefineAngle=0, RelativeTolerance=0.65, SimplePlanes=True, Tolerance=0})
mesh_brep_7 = MeshBrep(
    Brep=extrude_8,
    Settings={GridMaxCount=0, GridMinCount=16, JaggedSeams=False, MaxEdgeLength=0, MinEdgeLength=0.0001, MinTolerance=0, Refine=True, RefineAngle=0, RelativeTolerance=0.65, SimplePlanes=True, Tolerance=0})
mesh_brep_8 = MeshBrep(
    Brep=extrude_6,
    Settings={GridMaxCount=0, GridMinCount=16, JaggedSeams=False, MaxEdgeLength=0, MinEdgeLength=0.0001, MinTolerance=0, Refine=True, RefineAngle=0, RelativeTolerance=0.65, SimplePlanes=True, Tolerance=0})
mesh_brep_9 = MeshBrep(
    Brep=extrude_7,
    Settings={GridMaxCount=0, GridMinCount=16, JaggedSeams=False, MaxEdgeLength=0, MinEdgeLength=0.0001, MinTolerance=0, Refine=True, RefineAngle=0, RelativeTolerance=0.65, SimplePlanes=True, Tolerance=0})
mesh_brep_10 = MeshBrep(
    Brep=extrude_9,
    Settings={GridMaxCount=0, GridMinCount=16, JaggedSeams=False, MaxEdgeLength=0, MinEdgeLength=0.0001, MinTolerance=0, Refine=True, RefineAngle=0, RelativeTolerance=0.65, SimplePlanes=True, Tolerance=0})
move_6 = Move(Geometry=project_2.Geometry, Motion=unit_z_10)  # -> simplify(Geometry), Transform
line_7 = Line(Line=flatten(move_6.Geometry), LineMaterial=linebasicmaterial_3, DecimalAccuracy=3)
mesh_8 = Mesh(Mesh=flatten(mesh_brep_5), Name="meshFloors", Material=meshstandardmaterial, DecimalAccuracy=3)
mesh_9 = Mesh(Mesh=flatten(mesh_brep_6), Name="meshBathroom", Material=meshstandardmaterial_2, DecimalAccuracy=3)
mesh_10 = Mesh(Mesh=flatten(mesh_brep_7), Name="meshKitchen", Material=meshstandardmaterial_3, DecimalAccuracy=3)
mesh_11 = Mesh(Mesh=flatten(mesh_brep_8), Name="meshMeeting", Material=meshstandardmaterial_4, DecimalAccuracy=3)
mesh_12 = Mesh(Mesh=flatten(mesh_brep_9), Name="meshStairs", Material=meshstandardmaterial_5, DecimalAccuracy=3)
mesh_13 = Mesh(Mesh=flatten(mesh_brep_10), Name="meshLift", Material=meshstandardmaterial_6, DecimalAccuracy=3)
replace_text_18 = ReplaceText(Text=panel_24, Find="maxWalkX", Replace=highest_lowest_numbers.Highest, RecursiveReplace=False)
replace_text_19 = ReplaceText(Text=replace_text_18, Find="minWalkX", Replace=highest_lowest_numbers.Lowest, RecursiveReplace=False)
division_5 = Division(A=highest_lowest_numbers.Highest, B="1.42")
division_6 = Division(A=highest_lowest_numbers.Lowest, B="1.42")
replace_text_20 = ReplaceText(Text=replace_text_19, Find="maxSpeed", Replace=division_5, RecursiveReplace=False)
replace_text_21 = ReplaceText(Text=replace_text_20, Find="minSpeed", Replace=division_6, RecursiveReplace=False)
compile_scene_2 = CompileScene(Objects=flatten([mesh_8, mesh_9, mesh_10, mesh_11, mesh_12, mesh_13, line_7]))
write_text_file_4 = WriteTextFile(Path=file_path_2, FileName="walkAnalysis.json", Data=replace_text_21, Write=Toggle(True))
panel_25 = Panel(file_path_2)
boolean_toggle_4 = BooleanToggle(True)
serializeobject_2 = SerializeObject(Object3d=compile_scene_2, Minify=boolean_toggle_4, Run=boolean_toggle_4)
write_text_file_5 = WriteTextFile(Path=panel_25, FileName="floors.json", Data=serializeobject_2, Write=boolean_toggle_4)
